# Grasshopper definition Canopy_maker.gh (Grasshopper 1.0.7)
# plug-ins: MeshEdit Components

pt = Point([Point(-3.610669872, -34.65397583, 0), Point(14.85402792, -14.31151215, 0), Point(34.23376483, 77.21297745, 0), Point(28.29282379, 112.190963, 0)])
points = GetPoint(pt, AtLeast=4, AtMost=4, Prompt="Input Four Column Locations", Realtime=True)
column_radius = GetNumber(
    Slider(2, range=0.1..10),
    AtLeast=1,
    AtMost=4,
    Maximum=1.797693135e+308,
    Minimum=-1.797693135e+308,
    Prompt="Input Column Radii as List")
u_divisions = GetInteger(Slider(13, range=2..50), AtLeast=1, AtMost=1, Maximum=100, Minimum=2, Prompt="U Divisions (2 to 100)")
column_height = GetNumber(
    Slider(15.2, range=0.5..20),
    AtLeast=1,
    AtMost=4,
    Maximum=1.797693135e+308,
    Minimum=-1.797693135e+308,
    Prompt="Input Column Heights as List")
v_divisions = GetInteger(Slider(10, range=2..50), AtLeast=1, AtMost=1, Maximum=100, Minimum=2, Prompt="V Divisions (2 to 100)")
canopy_depth = GetNumber(
    Slider(2, range=0.1..5),
    AtLeast=1,
    AtMost=1,
    Maximum=1.797693135e+308,
    Minimum=-1.797693135e+308,
    Prompt="Input Canopy Depth")
Z = UnitZ(Factor=column_height)
move = Move(Geometry=points, Motion=Z)  # -> graft(Geometry), Transform
cyl = Cylinder(Base=points, Radius=column_radius, Length=column_height)
cap = CapHoles(Brep=cyl)
planesrf = PlaneSurface(Plane=points, XSize=Domain(-10, 10), YSize=Domain(-10, 10))
bang = ExplodeTree(Data=move.Geometry)  # -> Branch0, Branch1, Branch2, Branch3
srf4pt = _4PointSurface(CornerA=bang.Branch0, CornerB=bang.Branch1, CornerC=bang.Branch2, CornerD=bang.Branch3)  # -> reparameterize(Surface)
divide = DivideDomain²(Domain=srf4pt, UCount=u_divisions, VCount=v_divisions)
subsrf = Isotrim(Surface=srf4pt, Domain=divide)
debrep = DeconstructBrep(Brep=subsrf)  # -> Faces, Edges, Vertices
flip = FlipMatrix(Data=debrep.Vertices)
bang_2 = ExplodeTree(Data=simplify(flip))  # -> Branch0, Branch1, Branch2, Branch3
ln = Line(StartPoint=bang_2.Branch0, EndPoint=bang_2.Branch2)
ln_2 = Line(StartPoint=bang_2.Branch1, EndPoint=bang_2.Branch3)
join = JoinCurves(Curves=[ln_2, ln], Preserve=False)
cp = ControlPoints(Curve=join)  # -> Points, Weights, Knots
prune = PruneTree(Tree=cp.Points, Minimum="4", Maximum=0)
intcrv = Interpolate(Vertices=prune, Degree=3, Periodic=False, KnotStyle=1)  # -> Curve, Length, Domain
Z_2 = UnitZ(Factor=canopy_depth)
extr = Extrude(Base=intcrv.Curve, Direction=Z_2)
line = Line(Line((17.10392535, 11.81975855, 0), (-43.98509974, -29.93729657, 65.8773245)))
brep = Brep(extr)
area = MeshArea(Mesh=srf4pt)  # -> Area, Centroid
crv = Curve(brep)
midpt = CurveMiddle(Curve=crv)
pdecon = Deconstruct(Point=midpt)  # -> XComponent, YComponent, ZComponent
canopy = Mesh([cap, brep])
mshadow = MeshShadow(Mesh=canopy, Light=line, Plane=planesrf)
bnd = Bounds(Numbers=pdecon.XComponent)
boundary = BoundarySurfaces(Edges=mshadow)
context_bake = ContextBake(RH_OUTCanopy=canopy)
dedomain = DeconstructDomain(Domain=bnd)  # -> Start, End
shadow = Mesh(flatten(boundary))
rh_out_area = Data(area.Area)
context_print = ContextPrint(Text=rh_out_area)
gradient = Gradient(
    LowerLimit=0,
    UpperLimit=dedomain.End,
    Parameter=pdecon.ZComponent,
    stops=[0.15: RGB(255, 255, 0), 0.336: RGB(255, 192, 192), 0.524: RGB(40, 238, 237), 0.705: RGB(128, 128, 255), 0.848: RGB(0, 192, 192)])
rh_out_area_2 = GetNumber(rh_out_area, AtLeast=1, AtMost=1, Maximum=1.797693135e+308, Minimum=-1.797693135e+308)
context_bake_2 = ContextBake(RH_OUTShadow=shadow)
panel = Panel(rh_out_area)
c_script = CSharpScript(crv=crv, color=gradient)  # -> out, A; inputs crv: Curve, color: Color
# ---------- c_script: C# ----------
    var c = color.R + "," + color.G + "," + color.B;
    crv.SetUserString("color", c);
    A = crv;
# ---------- end c_script ----------
preview = CustomPreview(Geometry=extr, Material=gradient)
context_bake_3 = ContextBake(RH_OUTCrvs=c_script.A)
