# Grasshopper definition Exp Gh.gh (Grasshopper 1.0.7)
# plug-ins: Rhino.Inside for Autodesk Revit

number_slider = Slider(20, range=0..100000)
radius_of_inscribed_sphere_https_en_wiki = Panel("0.5*(5/2+(11/10)*5^0.5)^0.5")  # "Radius of inscribed sphere https://en.wikipedia.org/wiki/Regular_dodecahedron"
scale = GetInteger(number_slider, AtLeast=1, AtMost=1, Maximum=2147483647, Minimum=-2147483648)
multiplication = Multiplication(A=radius_of_inscribed_sphere_https_en_wiki, B=scale)
division = Division(A=scale, B="2*sin(pi/5)")

# ---- group: Generating orientation planes from dodecahedron
crv = Curve([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])
scale_2 = Scale(Geometry=crv, Center=Point(0, 0, 0), Factor=expr("x/10", scale))  # -> Geometry, Transform
srf = Surface(scale_2.Geometry)
join = BrepJoin(Breps=srf)  # -> Breps, Closed
debrep = DeconstructBrep(Brep=join.Breps)  # -> Faces, Edges, Vertices
debrep_2 = DeconstructBrep(Brep=debrep.Faces)  # -> Faces, Edges, Vertices
evalsrf = EvaluateSurface(Surface=reparameterize(debrep_2.Faces), Point="0.5,0.5")  # -> Point, Normal, UDirection, VDirection, Frame
area = Area(Geometry=debrep_2.Faces)  # -> Area, Centroid
vec2pt = Vector2Pt(PointA=area.Centroid, PointB=debrep_2.Vertices, Unitize=False)  # -> Vector, Length
pl = ConstructPlane(Origin=area.Centroid, XAxis=vec2pt.Vector, YAxis=evalsrf.Normal)

# ----
neg = Negative(Value=multiplication)
Y = UnitY(Factor=neg)
X = UnitX(Factor=division)
pt = Point(Y)
pt_2 = Point(X)

# ----
# 0.5 means equilateral scissor, and also the most closed packing one
arms_length_ratio_parameter = Slider(0.5, range=0..1)
offset_from_vertexes = Slider(0, range=0..1)
angle = Slider(5.3, range=0..45)

vec2pt_2 = Vector2Pt(PointA=pt, PointB=pt_2, Unitize=False)  # -> Vector, Length
Y_2 = UnitY(Factor=1)

# ---- group: Strut variables
hole_radius = Slider(0.102, range=0..1)
thickness = Slider(0.1, range=0..1)
width = Slider(0.15, range=0..1)

# ----
angle_2 = Angle(VectorA=Y_2, VectorB=vec2pt_2.Vector)  # -> Angle, Reflex
pt_3 = ConstructPoint(XCoordinate=0, YCoordinate=0, ZCoordinate=0)
ln = Line(StartPoint=pt, EndPoint=pt_3)
ln_2 = Line(StartPoint=pt_3, EndPoint=pt_2)
ln_3 = Line(StartPoint=pt, EndPoint=pt_2)
expansion = GetNumber(Slider(1, range=0..1), AtLeast=1, AtMost=1, Maximum=1.797693135e+308, Minimum=-1.797693135e+308)

xy = XYPlane(Origin=Point(0, 0, 0))
neg_2 = Negative(Value=offset_from_vertexes)
multiplication_2 = Multiplication(A=angle_2.Angle, B=arms_length_ratio_parameter)
offset = OffsetCurve(Curve=ln, Distance=offset_from_vertexes, Plane=xy, Corners=1)
offset_2 = OffsetCurve(Curve=ln_3, Distance=neg_2, Plane=xy, Corners=1)
llx = LineLine(Line1=offset, Line2=offset_2)  # -> ParamA, ParamB, PointA, PointB
rotate = Rotate(Geometry=offset, Angle=expr("-x", multiplication_2), Plane=llx.PointA)  # -> Geometry, Transform
llx_2 = LineLine(Line1=ln_2, Line2=rotate.Geometry)  # -> ParamA, ParamB, PointA, PointB

cos = Cosine(Value=degrees(angle))
tan = Tangent(Value=degrees(angle))
crv_cp = CurveClosestPoint(Point=llx_2.PointA, Curve=offset)  # -> Point, Parameter, Distance
crv_cp_2 = CurveClosestPoint(Point=llx_2.PointA, Curve=offset_2)  # -> Point, Parameter, Distance
division_2 = Division(A=crv_cp_2.Distance, B=cos)
division_3 = Division(A=crv_cp.Distance, B=cos)

max = Maximum(A=division_3, B=division_2)
dist = Distance(PointA=llx_2.PointA, PointB=llx.PointA)
division_4 = Division(A=max, B=dist)
dom = ConstructDomain(DomainStart=division_4, DomainEnd=1)
remap = RemapNumbers(Value=expansion, Source=Domain(0, 1), Target=dom)  # -> Mapped, Clipped
scale_3 = Scale(Geometry=llx_2.PointA, Center=llx.PointA, Factor=remap.Mapped)  # -> Geometry, Transform
cir = Circle(Plane=scale_3.Geometry, Radius=division_2)
cir_2 = Circle(Plane=scale_3.Geometry, Radius=division_3)
clx = CurveLine(Curve=cir, Line=offset_2)  # -> Points, Params, Count
clx_2 = CurveLine(Curve=cir_2, Line=offset)  # -> Points, Params, Count
pdecon = Deconstruct(Point=clx.Points)  # -> XComponent, YComponent, ZComponent
pdecon_2 = Deconstruct(Point=clx_2.Points)  # -> XComponent, YComponent, ZComponent
sort = SortList(Keys=pdecon.YComponent, ValuesA=clx.Points)  # -> Keys, ValuesA
sort_2 = SortList(Keys=pdecon_2.YComponent, ValuesA=clx_2.Points)  # -> Keys, ValuesA
item = ListItem(List=sort.ValuesA, Index=0, Wrap=True)  # -> Item, Item1
item_2 = ListItem(List=sort_2.ValuesA, Index=0, Wrap=True)  # -> Item, Item1
pt_4 = Point(scale_3.Geometry)
pl_3pt = Plane3Pt(PointA=flatten(item_2.Item1), PointB=flatten(pt_4), PointC=flatten(item.Item))
pl_3pt_2 = Plane3Pt(PointA=flatten(item_2.Item), PointB=flatten(pt_4), PointC=flatten(item.Item1))

Z = UnitZ(Factor="0.01")
xy_2 = XYPlane(Origin=Point(0, 0, 0))
pt_5 = ConstructPoint(XCoordinate=0, YCoordinate=0, ZCoordinate=0)
item_3 = ListItem(List=debrep.Vertices, Index=0, Wrap=True)
vlen = VectorLength(Vector=item_3)
number_slider_2 = Slider(30, range=0..100)
mesh = Mesh(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)
component_families = ComponentFamiliesPicker(<component families picker referenced from the Revit model>, SearchPattern="adaptive")
element_type_picker = ElementTypePicker(
    component_families,
    {"Simple_Panel : Simple_Panel": "873ef172-4808-4db4-bd26-4e048f778939-c55dacad-e4e1-4129-8297-13384fa49323-0004ffaa"}, selected="Simple_Panel : Simple_Panel")
trigger = Trigger(Interval=-1000, TimerInterval=1000, Target=compadap)

multiplication_3 = Multiplication(A=tan, B=crv_cp_2.Distance)
amp = Amplitude(Vector=vec2pt_2.Vector, Amplitude=multiplication_3)
multiplication_4 = Multiplication(A=tan, B=crv_cp.Distance)
rev = Reverse(Vector=amp)
Y_3 = UnitY(Factor=multiplication_4)
move = Move(Geometry=crv_cp.Point, Motion=Y_3)  # -> Geometry, Transform
move_2 = Move(Geometry=crv_cp_2.Point, Motion=rev)  # -> Geometry, Transform
merge = Merge(Data1=move.Geometry, Data2=llx_2.PointA, Data3=move_2.Geometry)
item_4 = ListItem(List=merge, Index=0, Wrap=True)  # -> Item, Item1, Item2
cir_3 = Circle(Plane=merge, Radius=width)
cir_4 = Circle(Plane=merge, Radius=hole_radius)
item_5 = ListItem(List=cir_3, Index=0, Wrap=True)  # -> Item, Item1, Item2
pl_3pt_3 = Plane3Pt(PointA=flatten(item_4.Item), PointB=flatten(item_4.Item1), PointC=flatten(item_4.Item2))
tanex = TangentLinesEx(CircleA=item_5.Item, CircleB=item_5.Item1)  # -> Tangent1, Tangent2
tanex_2 = TangentLinesEx(CircleA=item_5.Item1, CircleB=item_5.Item2)  # -> Tangent1, Tangent2
loft = Loft(
    Curves=[tanex_2.Tangent1, tanex_2.Tangent2],
    Options={Adjust=False, Closed=False, LoftEnds=0, LoftSimp=0, LoftType=0, Rebuild=10, Refit=0.01})
loft_2 = Loft(
    Curves=[tanex.Tangent1, tanex.Tangent2],
    Options={Adjust=False, Closed=False, LoftEnds=0, LoftSimp=0, LoftType=0, Rebuild=10, Refit=0.01})
runion = RegionUnion(Curves=[cir_3, loft_2, loft])
boundary = BoundarySurfaces(Edges=flatten([runion, cir_4]))
Z_2 = UnitZ(Factor=thickness)
smooth = SettingsQuality()

move_3 = Move(Geometry=boundary, Motion=Z)  # -> Geometry, Transform
move_4 = Move(Geometry=runion, Motion=Z)  # -> Geometry, Transform
move_5 = Move(Geometry=move_4.Geometry, Motion=Z_2)  # -> Geometry, Transform
mirror = Mirror(Geometry=[move_5.Geometry, move_4.Geometry], Plane=xy_2)  # -> Geometry, Transform
orient = Orient(Geometry=[move_4.Geometry, mirror.Geometry], Source=pl_3pt_3, Target=[pl_3pt_2, pl_3pt])  # -> Geometry, Transform
orient_2 = Orient(Geometry=orient.Geometry, Source=PlaneXY(0, 0, 0), Target=simplify(graft(pl)))  # -> flatten(Geometry), Transform

extr = Extrude(Base=move_3.Geometry, Direction=Z_2)
mesh_2 = MeshBrep(Brep=extr, Settings=smooth)

mirror_2 = Mirror(Geometry=mesh_2, Plane=xy_2)  # -> Geometry, Transform

orient_3 = Orient(Geometry=[mesh_2, mirror_2.Geometry], Source=pl_3pt_3, Target=[pl_3pt_2, pl_3pt])  # -> Geometry, Transform

item_6 = ListItem(List=orient_3.Geometry, Index=0, Wrap=True)
demesh = DeconstructMesh(Mesh=item_6)  # -> Vertices, Faces, Colours, Normals
vec2pt_3 = Vector2Pt(PointA=pt, PointB=demesh.Vertices, Unitize=False)  # -> Vector, Length
sort_3 = SortList(Keys=vec2pt_3.Length)  # -> Keys, ValuesA
item_7 = ListItem(List=sort_3.Keys, Index=0, Wrap=True)
orient_4 = Orient(Geometry=orient_3.Geometry, Source=PlaneXY(0, 0, 0), Target=simplify(graft(pl)))  # -> flatten(Geometry), Transform
meshcp = MeshClosestPoint(Point=pt_5, Mesh=orient_4.Geometry)  # -> Point, Index, Parameter
bnd = Bounds(Numbers=meshcp.Point)
remap_2 = RemapNumbers(Value=meshcp.Point, Source=bnd, Target=Domain(0, 1))  # -> Mapped, Clipped
gradient = Gradient(
    LowerLimit=0,
    UpperLimit=1,
    Parameter=remap_2.Mapped,
    stops=[0: RGB(65, 122, 24), 0: RGB(189, 24, 58), 0.00344: RGB(203, 252, 27), 0.292: RGB(192, 255, 255), 0.683: RGB(128, 128, 255), 1: RGB(192, 0, 192)])
c_script = CSharpScript(crv=orient_2.Geometry, color=gradient)  # -> out, A; inputs crv: Curve, color: Color
# ---------- c_script: C# ----------
    var c = color.R + "," + color.G + "," + color.B;
    crv.SetUserString("color", c);
    A = crv;
# ---------- end c_script ----------
division_5 = Division(A=item_7, B=vlen)
mesh_3 = Mesh(orient_4.Geometry)
scale_4 = Scale(Geometry=join.Breps, Center=Point(0, 0, 0), Factor=division_5)  # -> Geometry, Transform
structure = ContextBake(Structure=[mesh_3, c_script.A])
area_2 = Area(Geometry=scale_4.Geometry)  # -> Area, Centroid
msphere = MeshSphere(Base=area_2.Centroid, Radius=number_slider, UCount=number_slider_2, VCount=number_slider_2)
mesh_4 = Mesh(msphere)
panel = Panel(area_2.Area)
area_3 = Area(Geometry=msphere)  # -> Area, Centroid
qrmesh = QuadRemesh(Mesh=mesh_4, Settings={aqc=True, as=50, dhe=True, gci=0, null=False, pme=0, sa=0, tqc=2000})
faceb = FaceBoundaries(Mesh=qrmesh)
panel_2 = Panel(area_3.Area)
explode = Explode(Curve=faceb, Recursive=True)  # -> Segments, Vertices
panel_3 = Panel(explode.Vertices)
lng = ListLength(List=explode.Vertices)
number = Number(expr("x-1", lng))
cull_i = CullIndex(List=explode.Vertices, Indices=number, Wrap=True)
compadap = AddComponentAdaptive(Points=cull_i, Type=element_type_picker, TrackingMode=2)  # disabled
param = ElementParameter(Element=simplify(compadap), Parameter="Material")  # -> Element, Value
